# Grasshopper definition workshop files.gh (Grasshopper 1.0.8)
# plug-ins: Hops

panel = Panel("https://github.com/just-ajs/shape2fab-2025-grasshopper-on-the-web/raw/refs/heads/main/src/assets/wall.gh")
hops = Hops(
    A=Slider(2, range=2..20),
    B=Slider(5, range=5..20),
    CacheResultsInMemory=True,
    CacheSolveResults=True,
    RemoteDefinitionLocation="C:\Users\JJanssen\OneDrive - Thornton Tomasetti, Inc\Desktop\2025_S2F-Workshop.gh",
    RemoteSolveVersion=(0, 1, 0),
    ShowInput_Enabled=False,
    ShowInput_Path=False,
    SynchronousSolve=True)
hops_2 = Hops(
    _Path=panel,
    Height=17,
    Width=33,
    VerticalRotation=0,
    HorizontalRotation=0,
    Shape=1,
    CacheResultsInMemory=True,
    CacheSolveResults=True,
    RemoteDefinitionLocation="https://github.com/just-ajs/shape2fab-2025-grasshopper-on-the-web/raw/refs/heads/main/src/assets/wall.gh",
    RemoteSolveVersion=(0, 1, 0),
    ShowInput_Enabled=False,
    ShowInput_Path=True,
    SynchronousSolve=True)  # -> Geometry, Text
hops_3 = Hops(
    Height=17,
    Width=33,
    VerticalRotation=0,
    HorizontalRotation=0,
    ShapeType=1,
    CacheResultsInMemory=True,
    CacheSolveResults=True,
    RemoteDefinitionLocation="C:\Users\JJanssen\Documents\GitHub\shape2fab-2025-grasshopper-on-the-web\src\assets\wall_start.gh",
    RemoteSolveVersion=(0, 1, 0),
    ShowInput_Enabled=False,
    ShowInput_Path=False,
    SynchronousSolve=True)  # -> BrickWall, Result
panel_2 = Panel(hops)
